# Grasshopper definition Simple.ghx (Grasshopper 1.0.7)
# plug-ins: Caribou

# ---- group: Simple XML File
path = FilePath("Z:\Sites\Caribou\Caribou.Tests\Cases\simple.xml")

# ---- group: Melbourne XML File
path_2 = FilePath("Z:\Sites\Caribou\Caribou.Tests\Cases\melbourne.xml")

# ---- group: Multiple XML Files
path_3 = FilePath(["Z:\Sites\Caribou\Caribou.Tests\Cases\multipleA.xml", "Z:\Sites\Caribou\Caribou.Tests\Cases\multipleB.xml", "Z:\Sites\Caribou\Caribou.Tests\Cases\multipleC.xml"])

# ----
panel = Panel("""highway:
traffic_signals""")
read_file = ReadFile(File=path_2, PerLineParse=False)
text = Text(["craft", "building", "amenity:*", "waterway:", panel])
openstreetmap = OpenStreetMap(OSMContent=read_file, OSMFeatures=text)  # -> Ways, Tags, Features, Debug
openstreetmap_2 = OpenStreetMap(OSMContent=read_file, OSMFeatures=text)  # -> Nodes, Tags, Report, Debug
panel_2 = Panel(openstreetmap.Tags)
panel_3 = Panel(openstreetmap.Features)
panel_4 = Panel(openstreetmap_2.Nodes)
panel_5 = Panel(openstreetmap_2.Tags)
panel_6 = Panel(openstreetmap_2.Report)
panel_7 = Panel(openstreetmap.Ways)
panel_8 = Panel("Vis in Rhino")
panel_9 = Panel("Vis in Grasshopper")
list_item = ListItem(List=openstreetmap.Features, Index=0, Wrap=True)  # -> flatten(Item)

color_per_branch = ColorPerBranch(geometry=openstreetmap_2.Nodes)  # -> geometry_4, colour_2
color_per_branch_2 = ColorPerBranch(geometry=openstreetmap.Ways)  # -> geometry_4, colour_2
custom_preview = CustomPreview(Geometry=color_per_branch.geometry_4, Material=color_per_branch.colour_2)
custom_preview_2 = CustomPreview(Geometry=color_per_branch_2.geometry_4, Material=color_per_branch_2.colour_2)

text_2 = Text(list_item)
legend = Legend(Colour=color_per_branch.colour_2, Tags=text_2, LegendType=1)

# ==== cluster ColorPerBranch
geometry = ClusterInput()
geometry_2 = Geometry(geometry)
group = Group(Objects=geometry_2)  # -> flatten(Group)
list_length = ListLength(List=group)
panel = Panel(group)
series = Series(Start=0, Step=1, Count=list_length)
gradient = Gradient(
    LowerLimit=0,
    UpperLimit=list_length,
    Parameter=series,
    stops=[0: RGB(243, 57, 0), 0.1: RGB(236, 27, 60), 0.2: RGB(210, 0, 118), 0.3: RGB(103, 0, 120), 0.4: RGB(39, 72, 161), 0.5: RGB(1, 192, 229), 0.6: RGB(18, 178, 90), 0.7: RGB(79, 186, 8), 0.8: RGB(220, 237, 32), 0.9: RGB(247, 159, 20), 1: RGB(243, 57, 0)])
geometry_3 = Geometry(geometry_2)
colour = Colour(gradient)
geometry_4 = ClusterOutput(geometry_3)
colour_2 = ClusterOutput(colour)
